# Dynamo graph auto-column-placement.dyn (Dynamo 2.18.1.5096)

family_types = FamilyTypes("Columns_Rectangular:600x600mm")
categories = Categories("OST_Grids")
all_elements_of_category = ElementsOfCategory(Category=categories)
curve = Grid.Curve(grid=all_elements_of_category)
intersect = Geometry.Intersect(geometry=curve, other=curve, lacing=CrossProduct)
code_block = CodeBlock { "Point"; }
string_from_object = FromObject(object=intersect)
code_block_2 = CodeBlock { 0; 5; }
substring = String.Substring(string=string_from_object, startIndex=code_block_2.out0, length=code_block_2.out1)
eq = code_block == substring
filterByBoolMask = List.FilterByBoolMask(list=intersect, mask=eq)
levels = Levels("Level 0")
byPointAndLevel = FamilyInstance.ByPointAndLevel(familyType=family_types, point=filterByBoolMask.in, level=levels)
filter = List.Filter()  # unwired: list, condition
