# Dynamo graph ImportExport_Data To Excel.dyn (Dynamo 2.18.1.5096)
# author: Dynamo Team
# Dynamo Import Export Sample

file_path = Filename("..\..\Data\icosohedron_points.csv")
string = StringInput("helix")
number = DoubleInput(0)
number_slider = DoubleSlider(1.793, range=0..5 step 0.1)
code_block = CodeBlock(numCircles=number_slider) { 0..(360*numCircles)..10; }
cos = Math.Cos(angle=code_block, lacing=Longest)
sin = Math.Sin(angle=code_block, lacing=Longest)
code_block_2 = CodeBlock(x=code_block) { x/100; }
byCoordinates = Point.ByCoordinates(x=cos, y=sin, z=code_block_2, lacing=Longest)
code_block_3 = CodeBlock(pt=byCoordinates) { [pt.X,pt.Y,pt.Z]; }
transpose = List.Transpose(lists=code_block_3)
exportExcel = Data.ExportExcel(filePath=file_path, sheetName=string, startRow=number, startColumn=number, data=transpose)
