# Dynamo graph tower-mass.dyn (Dynamo 2.18.1.5096)

string = StringInput("height")
parameterByName = Parameter.ParameterByName(name=string)  # unwired: element
watch = Watch(parameterByName)
number = DoubleInput(20)
setValue = Parameter.SetValue(parameter=string, value=number)
watch_2 = Watch(setValue)
number_2 = DoubleInput(2)
number_3 = DoubleInput(3)
number_4 = DoubleInput(4)
byLengths = Cuboid.ByLengths(width=number_2, length=number_3, height=number_4)
